# Grasshopper definition deploy.gh (Grasshopper 1.0.4)
# plug-ins: HoopSnake, GH_CPython

xy = XYPlane(Origin=Point(0, 0, 0))
sight_line_distance = Slider(60, range=0..100)
sight_line_count = Slider(16, range=3..16)
road_obstacles = Curve(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)

subtraction = Subtraction(A=sight_line_count, B1=1)
division = Division(APi=3.141592654, B=subtraction)
series = Series(S5=-1.570796327, Step=division, Count=sight_line_count)

# ----
# CALCULATE STATE
flatten = FlattenTree(Tree=road_obstacles, Path="{0}")
series_2 = Series(Start=1, N0=0, Count=sight_line_count)  # -> graft(Series)

# ----
# SEND STATE TO SERVER
panel = Panel("Format(\"{0:0.000000000000000}\", x)")

# ----
# ACTIONS
actions = Panel(""".1
0
-.1""")
multiplication = Multiplication(A=actions, BPi=3.141592654)

speed = Slider(15, range=1..20)

states = Panel(join)
action = Panel(action_2)
hs = HoopSnake(
    StartingData=xy,
    Data=item_3,
    Hoopsnake_Data_autoUpdate=False,
    Hoopsnake_Data_dataLimit=2147483647,
    Hoopsnake_Data_resetCounter=True,
    Hoopsnake_Data_updateView=True)  # -> Feedback, FeedbackHistory, LoopsCounter, IterationsCounter
orientation_plane = Plane(hs.Feedback)
iteration = Panel(hs.IterationsCounter)

rectangle = Rectangle(Plane=orientation_plane, XSize=Domain(-2, 2), YSize=Domain(-5, 5), Radius=0)  # -> Rectangle, Length

deplane = DeconstructPlane(Plane=orientation_plane)  # -> Origin, XAxis, YAxis, ZAxis
# CREATE SIGHTLINES
vrot = Rotate(Vector=deplane.YAxis, XZ=Vector(0, 0, 1), Angle=series)
line = LineSDL(Start=deplane.Origin, Direction=vrot, Length=sight_line_distance)

ccx = CurveCurve(CurveA=graft(line), CurveB=flatten)  # -> Points, ParamsA, ParamsB
trim = TrimTree(Tree=ccx.ParamsA, Depth=1)
merge = Merge(Data1=trim, Data2=series_2)
sort = SortList(Keys=merge)  # -> Keys, ValuesA
item = ListItem(List=sort.Keys, Index=0, Wrap=True)

eval = EvaluateCurve(Curve=graft(line), Parameter=item)  # -> Point, Tangent, Angle

flatten_2 = FlattenTree(Tree=item, Path="{0}")
rev = ReverseList(List=flatten_2)
eval_2 = Evaluate(F=panel, x=rev)
join = TextJoin(Text=eval_2, Join=" ")
gh_client = Gh_client(state_inp=join)  # -> action_out; inputs state_inp: list
# ---------- gh_client: Python ----------
# -*- coding: utf-8 -*-
""" 
Python Script
Created on  Monday November 2018 05:09:38 
@author:  Nariddh 

[desc]
Description of the plugin Here
Write here any thing... 
[/desc]

ARGUMENTS:
----------
<inp> 
    state_inp
</inp>

RETURN:
----------
<out>
    action_out
</out>
"""

from socket import socket, AF_INET, SOCK_STREAM

HOST = '127.0.0.1'
PORT = 8082

# Encode GH input
state_str = str(state_inp)
state_byt = state_str.encode()

# Send State
with socket(AF_INET, SOCK_STREAM) as s:
    s.connect((HOST, PORT))
    s.send(state_byt)

# Receive Action
with socket(AF_INET, SOCK_STREAM) as s:
    s.connect((HOST, PORT))
    action_byt = s.recv(1024)

action_out = action_byt.decode()
# ---------- end gh_client ----------
action_2 = Number(gh_client)

item_2 = ListItem(List=multiplication, Index=action_2, Wrap=True)

# ----
# ACT
prot = RotatePlane(Plane=orientation_plane, Angle=item_2)
deplane_2 = DeconstructPlane(Plane=prot)  # -> Origin, XAxis, YAxis, ZAxis
amp = Amplitude(Vector=deplane_2.YAxis, Amplitude=speed)
move = Move(Geometry=prot, Motion=amp)  # -> Geometry, Transform

# ----
# TERMINATION CONDITION
ln = Line(StartPoint=orientation_plane, EndPoint=move.Geometry)
merge_2 = Merge(Data1=move.Geometry, Data2=orientation_plane)
ccx_2 = CurveCurve(CurveA=ln, CurveB=road_obstacles)  # -> Points, ParamsA, ParamsB
clean = CleanTree(RemoveNulls=True, RemoveInvalid=True, RemoveEmpty=True, Tree=merge_2)
flatten_3 = FlattenTree(Tree=ccx_2.Points, Path="{0}")
lng = ListLength(List=flatten_3)

# ----
# VIZ
car = Rectangle(rectangle.Rectangle)
sightlines = Line(line)
end_points = Point(eval.Point)
action_line = Line(ln)

# ----
# RESET
item_3 = ListItem(List=clean, Index=lng, Wrap=True)
simplify = SimplifyTree(Tree=item_3, Front=False)
